# Grasshopper definition curved_slicing_master.gh (Grasshopper 1.0.7)

data_folder_name = Panel("beam1A")
data_folder_name_2 = Panel("beam3B")
data_folder_name_3 = Panel("beam1B")
data_folder_name_4 = Panel("beam3A")
data_folder_name_5 = Panel("beam2B")
data_folder_name_6 = Panel("beam2A")
data_folder_name_7 = Panel("beam1C")
data_folder_name_8 = Panel("beam3C")
data_folder_name_9 = Panel("beam2C")

# ---- group: Select example
list = ValueList({"beam1A": 0, "beam1B": 1, "beam2A": 2, "beam2B": 3, "beam3A": 4, "beam3B": 5, "beam1C": 6, "beam2C": 7, "beam3C": 8}, selected="beam1B")

# ----
merge = Merge(
    Data1=data_folder_name,
    Data2=data_folder_name_3,
    Data3=data_folder_name_6,
    Data4=data_folder_name_5,
    Data5=data_folder_name_4,
    Data6=data_folder_name_2,
    Data7=data_folder_name_7,
    Data8=data_folder_name_9,
    Data9=data_folder_name_8)
item = ListItem(List=merge, Index=list, Wrap=True)

# ----
# Inputs
py = PythonScript()  # -> path
# ---------- py: Python ----------
import sys
import os

ghComp = ghenv.Component
ghDoc = ghComp.OnPingDocument()

# the full path of the gh file
path = ghDoc.FilePath
# the current directory 
path = os.path.abspath(os.path.join(path, ".."))

print path
# ---------- end py ----------

# ---- group: Folder name
data = Data(item)

# ----
load_mesh = GhPythonScript(recompute=Button(), path=py, folder=data, filename="edited_mesh.obj")  # -> out, mesh
# ---------- load_mesh: Python ----------
__author__ = "ioanna"

import os
import Rhino.Geometry as rg
import rhinoscriptsyntax as rs
from compas.datastructures import Mesh
from compas_ghpython.artists import MeshArtist
from compas.geometry import Frame
from compas_ghpython.utilities import list_to_ghtree


vertices = []
faces = []

with open(os.path.join(path, folder, 'output', filename), "r") as file:
    for line in file:
        if line.startswith('#'):
            continue
        values = line.split()
        if not values:
            continue
            
        if values[0] == 'v':
            v = list(map(float, values[1:4]))
            vertices.append(v)
        elif values[0] == 'f':
            face = [int(w.split('/')[0]) for w in values[1:]]
            faces.append(face)
        
print('Vertices : ', len(vertices))    
print('Faces : ', len(faces))


mesh = rg.Mesh()

for v in vertices:
    mesh.Vertices.Add(v[0], v[1], v[2]);
for i, f in enumerate(faces):
    mesh.Faces.AddFace(f[0]-1, f[1]-1, f[2]-1);
    



#mesh = Mesh.from_vertices_and_faces(vertices, faces)
#mesh = Mesh.from_obj(os.path.join(path, folder, 'output', filename))


#print (len(list(mesh.vertices())))
#artist = MeshArtist(mesh)
#mesh = artist.draw()
# ---------- end load_mesh ----------
load_mesh_2 = GhPythonScript(recompute=Button(), path=py, folder=data, filename="mesh.obj")  # -> out, mesh
# ---------- load_mesh_2: Python ----------
__author__ = "ioanna"

import os
import Rhino.Geometry as rg
import rhinoscriptsyntax as rs
from compas.datastructures import Mesh
from compas_ghpython.artists import MeshArtist
from compas.geometry import Frame
from compas_ghpython.utilities import list_to_ghtree


vertices = []
faces = []

with open(os.path.join(path, folder,  filename), "r") as file:
    for line in file:
        if line.startswith('#'):
            continue
        values = line.split()
        if not values:
            continue
            
        if values[0] == 'v':
            v = list(map(float, values[1:4]))
            vertices.append(v)
        elif values[0] == 'f':
            face = [int(w.split('/')[0]) for w in values[1:]]
            faces.append(face)
        
print('Vertices : ', len(vertices))    
print('Faces : ', len(faces))


mesh = rg.Mesh()

for v in vertices:
    mesh.Vertices.Add(v[0], v[1], v[2]);
for i, f in enumerate(faces):
    mesh.Faces.AddFace(f[0]-1, f[1]-1, f[2]-1);
    



#mesh = Mesh.from_vertices_and_faces(vertices, faces)
#mesh = Mesh.from_obj(os.path.join(path, folder, 'output', filename))


#print (len(list(mesh.vertices())))
#artist = MeshArtist(mesh)
#mesh = artist.draw()
# ---------- end load_mesh_2 ----------
mesh = Mesh(load_mesh_2.mesh)
mesh_2 = Mesh(load_mesh.mesh)
panel = Panel(py)
panel_2 = Panel(data)

# ---- group: Input mesh
mesh_3 = Mesh(mesh_2)

# ----
# Input
# Create boundary vertices file (json)
mesh_4 = Mesh(mesh)
medges = MeshEdges(Mesh=mesh_4)  # -> NakedEdges, InteriorEdges, NonManifoldEdges

# ----
# Load Data
# Load vertex indices
# Debugging
panel_3 = Panel("saddles_high.json")
demesh = DeconstructMesh(Mesh=mesh_3)  # -> Vertices, Faces, Colours, Normals
number_slider = Slider(20, range=0..20)
merge_2 = Merge(Data1=panel_3, Data2="height_saddles.json", Data3="saddles.json")
csloadjsondata = CsLoadJsonData(recompute=Button(), json_name=merge_2, path=py, folder_name=data)  # -> out, simplify(data); inputs recompute: Boolean
# ---------- csloadjsondata: Python ----------
"""Loads a json file from the output folder. """

import compas_slicer_ghpython.visualization as gh_compas_slicer
gh_compas_slicer = reload(gh_compas_slicer)

if json_name and path and folder_name:
    data = gh_compas_slicer.load_json_file(path, folder_name, json_name)
else:
    gh_compas_slicer.missing_input()
# ---------- end csloadjsondata ----------
branch = TreeBranch(Tree=csloadjsondata.data, Path="2", MaintainPaths=True)
branch_2 = TreeBranch(Tree=csloadjsondata.data, Path="1", MaintainPaths=True)
branch_3 = TreeBranch(Tree=csloadjsondata.data, Path="0", MaintainPaths=True)
item_2 = ListItem(List=demesh.Vertices, Index=branch, Wrap=True)
item_3 = ListItem(List=demesh.Vertices, Index=branch_2, Wrap=True)
item_4 = ListItem(List=branch_3, Index=0, Wrap=True)
cloud = CloudDisplay(Points=item_3, Colours=ColourSwatch(SwatchColor=RGB(235, 235, 235)), Size=number_slider, SpriteType=1)
cloud_2 = CloudDisplay(Points=item_4, Colours=ColourSwatch(SwatchColor=RGB(107, 235, 52)), Size=number_slider, SpriteType=1)
cloud_3 = CloudDisplay(Points=item_2, Colours=ColourSwatch(SwatchColor=RGB(255, 0, 0)), Size=number_slider, SpriteType=1)
point_list = PointList(Points=item_3, Size="20")

# ----
# Load Slicer
# Results
button = Button()
ghpython_script = GhPythonScript(x=button, path=py, folder_name=data)  # -> out, filenames
# ---------- ghpython_script: Python ----------
import visualization as vis
vis=reload(vis)
filenames=vis.load_slicer_names(path,folder_name)
# ---------- end ghpython_script ----------
csloadslicer = CsLoadSlicer(recompute=button, json_name=ghpython_script.filenames, path=py, folder_name=data)  # -> out, mesh, paths, are_closed, all_points, gras, pts; inputs recompute: Boolean
# ---------- csloadslicer: Python ----------
"""
Loads a Slicer class from its json file in the 'output' folder.

"""

import compas_slicer_ghpython.visualization as gh_compas_slicer
gh_compas_slicer = reload(gh_compas_slicer)
import math
import visualization as vis
vis=reload(vis)

if path and folder_name and json_name:
    try:
        paths,pts, gras= vis.load_slicer_tree(path, folder_name, json_name,0.00213,0.00052,math.pi/10,False)
    except:
        mesh,paths,are_closed,all_points=gh_compas_slicer.load_slicer(path,folder_name,json_name)
else:
    gh_compas_slicer.missing_input()
import rhinoscriptsyntax as rs
# ---------- end csloadslicer ----------

# ----
# Load Mesh
panel_4 = Panel("cutted_mesh")
button_2 = Button()
csfindfilenames = CsFindFilenames(recompute=button_2, starts_with=panel_4, ends_with=".obj", path=py, folder_name=data)  # -> out, filenames, n; inputs recompute: Boolean
# ---------- csfindfilenames: Python ----------
"""
Finds all the filenames from the output directory that have the specified name. 

"""

import compas_slicer_ghpython.visualization as gh_compas_slicer
gh_compas_slicer = reload(gh_compas_slicer)
import os

if starts_with and ends_with and path and folder_name:
    filenames = gh_compas_slicer.get_files_with_name(starts_with, ends_with, os.path.join(path, folder_name, 'output'))
    n = len(filenames)
else:
    gh_compas_slicer.missing_input()
# ---------- end csfindfilenames ----------
cull_index = CullIndex(List=csfindfilenames.filenames, Indices="0", Wrap=True)
button_3 = Button()
load_mesh_3 = GhPythonScript(recompute=button_2, path=py, folder=data, filename=cull_index)  # -> out, mesh; same code as load_mesh
mesh_5 = Mesh(load_mesh_3.mesh)
list_length = ListLength(List=mesh_5)
division = Division(A="1", B=list_length)
series = Series(Start=0, Step=division, Count=list_length)
colour_hsl = ColourHSL(Alpha="1", Hue=series, Saturation=1, Luminance=0.5)  # -> simplify(graft(Colour))
demesh_2 = DeconstructMesh(Mesh=mesh_5)  # -> simplify(Vertices), simplify(Faces), Colours, Normals
conmesh = ConstructMesh(Vertices=demesh_2.Vertices, Faces=demesh_2.Faces, Colours=colour_hsl)

# ----
# Load Layer Height
panel_5 = Panel("layer_height_vertices")
button_4 = Button()
csfindfilenames_2 = CsFindFilenames(recompute=button_4, starts_with=panel_5, ends_with=".json", path=py, folder_name=data)  # -> out, filenames, n; inputs recompute: Boolean; same code as csfindfilenames
csinterpolation = CsInterpolation(recompute=button_4, json_names=csfindfilenames_2.filenames, path=py, folder_name=data)  # -> out, influences; inputs recompute: Boolean, json_names: list
# ---------- csinterpolation: Python ----------
"""
Interpolation of the two distance fields that are loaded from the 'output' folder. 

"""
#asdf
import visualization as gh_compas_slicer
import Grasshopper.DataTree as dt
import Grasshopper.Kernel.Data.GH_Path as ph
gh_compas_slicer = reload(gh_compas_slicer)
influences=dt[object]()

def veky_influence(veky,influences_list):
    influence_list = influences_list[veky]
    return influence_list

influences = gh_compas_slicer.load_nested_data(path, folder_name, json_names)

#print(influences_list)


print(influences)
# ---------- end csinterpolation ----------
flatten_tree = FlattenTree(Tree=csinterpolation.influences, Path="{0}")
ghpython_script_2 = GhPythonScript(x=flatten_tree)  # -> out, a; inputs x: list
# ---------- ghpython_script_2: Python ----------
import statistics
x=[xi for xi in x if isinstance(xi,float)]
a=statistics.mean(x)
# ---------- end ghpython_script_2 ----------
mesh_6 = Mesh(mesh_5)
subtraction = Subtraction(A=csinterpolation.influences, B=ghpython_script_2.a)
demesh_3 = DeconstructMesh(Mesh=mesh_6)  # -> Vertices, Faces, Colours, Normals
division_2 = Division(A=subtraction, B=flatten_tree)
# Analysis
distances = Number(division_2)
gradient = Gradient(
    LowerLimit="-1",
    UpperLimit="1",
    Parameter=distances,
    stops=[0: RGB(128, 0, 0), 0.102: RGB(255, 128, 0), 0.202: RGB(255, 192, 128), 0.303: RGB(255, 255, 0), 0.4: RGB(255, 255, 128), 0.498: RGB(0, 255, 0), 0.604: RGB(128, 255, 255), 0.7: RGB(0, 255, 255), 0.8: RGB(128, 192, 255), 0.901: RGB(0, 128, 255), 1: RGB(0, 0, 255)])
split_argb = SplitARGB(Colour=gradient)  # -> Alpha, Red, Green, Blue
colour_rgb_f = ColourRGBF(Alpha=Slider(1, range=0..1), Red=split_argb.Red, Green=split_argb.Green, Blue=split_argb.Blue)
conmesh_2 = ConstructMesh(Vertices=demesh_3.Vertices, Faces=demesh_3.Faces, Colours=colour_rgb_f)

join = JoinCurves(Curves=flatten(medges.NakedEdges), Preserve=False)
item_5 = ListItem(List=flatten(join), Index=0, Wrap=False)  # -> Item, Item1, Item2, Item3
curve = Curve([item_5.Item1, item_5.Item3])
curve_2 = Curve([item_5.Item2, item_5.Item])
demesh_4 = DeconstructMesh(Mesh=mesh_4)  # -> Vertices, Faces, Colours, Normals

crv = Curve(curve)
crv_2 = Curve(curve_2)

curve_display = CSharpScript(Curve=crv, Width=Slider(7.82, range=0..20), Colour=ColourSwatch(SwatchColor=RGB(135, 26, 26)))  # inputs Curve: Curve, Width: Int32, Colour: Color, Dash: String
# ---------- curve_display: C# ----------
    if (Curve == null) return;
    if (Width <= 0) return;

    double[] pattern = ParseDashPattern(Dash);
    IEnumerable<Curve> segments = ApplyDashPattern(Curve, pattern);

    _clip = BoundingBox.Union(_clip, Curve.GetBoundingBox(false));
    foreach (Curve segment in segments)
    {
      _curves.Add(segment);
      _colors.Add(Colour);
      _widths.Add(Width);
    }
# ---------- curve_display: C# additional code ----------
  /// <summary>
  /// Parse a dash pattern.
  /// </summary>
  /// <param name="pattern">Pattern to parse.</param>
  /// <returns>Array of dashes and gaps.</returns>
  private double[] ParseDashPattern(string pattern)
  {
    if (string.IsNullOrWhiteSpace(pattern))
      return null;

    string[] fragments = pattern.Split(new char[] {' '});
    if (fragments == null || fragments.Length == 0)
      return null;

    double[] values = new double[fragments.Length];
    for (int i = 0; i < fragments.Length; i++)
    {
      double v;
      if (!double.TryParse(fragments[i], out v))
        throw new Exception(fragments[i] + " is a not a valid number.");

      if (v <= 0.0)
        throw new Exception("Dashes or gaps must have a strictly positive length.");

      values[i] = v;
    }

    return values;
  }
  /// <summary>
  /// Apply a dash+gap pattern to a curve.
  /// </summary>
  private IEnumerable<Curve> ApplyDashPattern(Curve curve, double[] pattern)
  {
    if (pattern == null || pattern.Length == 0)
      return new Curve[] { curve };

    double curveLength = curve.GetLength();
    List<Curve> dashes = new List<Curve>();

    double offset0 = 0.0;
    int index = 0;
    while(true)
    {
      // Get the current dash length.
      double dashLength = pattern[index++];
      if (index >= pattern.Length)
        index = 0;

      // Compute the offset of the current dash from the curve start.
      double offset1 = offset0 + dashLength;
      if (offset1 > curveLength)
        offset1 = curveLength;

      // Solve the curve parameters at the current dash start and end.
      double t0, t1;
      curve.LengthParameter(offset0, out t0);
      curve.LengthParameter(offset1, out t1);

      Curve dash = curve.Trim(t0, t1);
      if (dash != null)
        dashes.Add(dash);

      // Get the current gap length.
      double gapLength = pattern[index++];
      if (index >= pattern.Length)
        index = 0;

      // Set the start of the next dash to be the end of the current
      // dash + the length of the adjacent gap.
      offset0 = offset1 + gapLength;

      // Abort when we've reached the end of the curve.
      if (offset0 >= curveLength)
        break;
    }

    return dashes;
  }

  private BoundingBox _clip;
  private readonly List<Curve> _curves = new List<Curve>();
  private readonly List<Color> _colors = new List<Color>();
  private readonly List<int> _widths = new List<int>();

  /// <summary>
  /// This method will be called once every solution, before any calls to RunScript.
  /// </summary>
  public override void BeforeRunScript()
  {
    _clip = BoundingBox.Empty;
    _curves.Clear();
    _colors.Clear();
    _widths.Clear();
  }

  /// <summary>
  /// Return a BoundingBox that contains all the geometry you are about to draw.
  /// </summary>
  public override BoundingBox ClippingBox
  {
    get { return _clip; }
  }
  /// <summary>
  /// Draw all wires and points in this method.
  /// </summary>
  public override void DrawViewportWires(IGH_PreviewArgs args)
  {
    for (int i = 0; i < _curves.Count; i++)
      args.Display.DrawCurve(_curves[i], _colors[i], _widths[i]);
  }
# ---------- end curve_display ----------

pull = PullPoint(Point=demesh_4.Vertices, Geometry=crv, ClosestOnly=True)  # -> ClosestPoint, Distance
dist = Distance(PointA=demesh_4.Vertices, PointB=pull.ClosestPoint)
smaller = SmallerThan(FirstNumber=dist, SecondNumber="0.001")  # -> SmallerThan, OrEqualTo
index = ItemIndex(List=demesh_4.Vertices, Item=demesh_4.Vertices)
dispatch = Dispatch(List=index, DispatchPattern=smaller.SmallerThan)  # -> ListA, ListB
dispatch_2 = Dispatch(List=demesh_4.Vertices, DispatchPattern=smaller.SmallerThan)  # -> ListA, ListB
pt = Point(dispatch_2.ListA)
int = Integer(dispatch.ListA)

pull_2 = PullPoint(Point=demesh_4.Vertices, Geometry=crv_2, ClosestOnly=True)  # -> ClosestPoint, Distance
dist_2 = Distance(PointA=demesh_4.Vertices, PointB=pull_2.ClosestPoint)
smaller_2 = SmallerThan(FirstNumber=dist_2, SecondNumber="0.001")  # -> SmallerThan, OrEqualTo
index_2 = ItemIndex(List=demesh_4.Vertices, Item=demesh_4.Vertices)
dispatch_3 = Dispatch(List=index_2, DispatchPattern=smaller_2.SmallerThan)  # -> ListA, ListB
dispatch_4 = Dispatch(List=demesh_4.Vertices, DispatchPattern=smaller_2.SmallerThan)  # -> ListA, ListB
pt_2 = Point(dispatch_4.ListA)
int_2 = Integer(dispatch_3.ListA)

all_points = Point(csloadslicer.all_points)
paths = Curve(simplify(csloadslicer.paths))
mesh_7 = Mesh(csloadslicer.mesh)

# ---- group: Press button to save json files
button_5 = Button()

# ----
save_to_json = GhPythonScript(save=button_5, list=int_2, path=py, folder_name=data, json_name="boundaryHIGH.json")  # -> out; inputs save: Boolean, list: list
# ---------- save_to_json: Python ----------
"""
Saves to Json

"""

import compas_slicer_ghpython.visualization as gh_compas_slicer
gh_compas_slicer = reload(gh_compas_slicer)


if save:
    if list and path and folder_name and json_name:
        gh_compas_slicer.save_json_file(list, path, folder_name, json_name)
    else:
        gh_compas_slicer.missing_input()
else:
    print('No files were saved because save = False')
# ---------- end save_to_json ----------
save_to_json_2 = GhPythonScript(save=button_5, list=int, path=py, folder_name=data, json_name="boundaryLOW.json")  # -> out; inputs save: Boolean, list: list; same code as save_to_json
panel_6 = Panel(csinterpolation.influences)
panel_7 = Panel(save_to_json)
panel_8 = Panel(save_to_json_2)
